# Grasshopper definition Topologicpy Testing in Grasshopper.gh (Grasshopper 1.0.8)
# plug-ins: Karamba3D, TopologicGH, Human

# ----
# Import Models
brep = Brep(flatten([<brep referenced from the Rhino model> x2]))

area = Area(Geometry=brep)  # -> Area, Centroid
deconstruct = Deconstruct(Point=area.Centroid)  # -> XComponent, YComponent, ZComponent
list_item = ListItem(List=brep, Index=0, Wrap=True)  # -> Item, Item1
construct_point = ConstructPoint(XCoordinate=deconstruct.XComponent, YCoordinate=0, ZCoordinate=deconstruct.ZComponent)
python_3_script = Python3Script(c1=list_item.Item, c2=list_item.Item1)  # -> out, a
# ---------- python_3_script: Python ----------
import rhinoscriptsyntax as rs
import Rhino as rc

from topologicpy.Vertex import Vertex
from topologicpy.Edge import Edge
from topologicpy.Wire import Wire
from topologicpy.Face import Face
from topologicpy.Shell import Shell
from topologicpy.Cell import Cell
from topologicpy.CellComplex import CellComplex
from topologicpy.Cluster import Cluster
from topologicpy.Graph import Graph
from topologicpy.Topology import Topology
from topologicpy.Dictionary import Dictionary
from topologicpy.Matrix import Matrix
from topologicpy.Helper import Helper


c1 = c1
c2 = c2
c1 = Topology.ByBREPPath(c1)
c2 = Topology.ByBREPPath(c2)
c = CellComplex. ByCells([c1,c2])
#cells = Topology.Cells(c)
d1 = Dictionary.ByKeyValue("type", "male")
d2 = Dictionary.ByKeyValue("type", "female")
c1 = Topology.SetDictionary(c1, d1)
c2 = Topology.SetDictionary(c2, d2)
# ---------- end python_3_script ----------
sort_list = SortList(Keys=flatten(construct_point), ValuesValuesA=brep)  # -> Keys, ValuesValuesA
topology_bygeometry = TopologyByGeometry(Tolerance=0.0001)  # -> simplify(Topology)
list_length = ListLength(List=sort_list.ValuesValuesA)
series = Series(Start=0, Step=1, Count=list_length)
cellcomplex_bycells = CellComplexByCells(Cells=topology_bygeometry)
cellcomplex_cells = CellComplexCells(CellComplex=cellcomplex_bycells)

# ----
# Create Dictionaries By Cell
panel = Panel("ID")
dictionary_bykeysvalues = DictionaryByKeysValues(Keys=panel, Values=simplify(graft(series)))  # -> simplify(Dictionary)
topology_bygeometry_2 = TopologyByGeometry(Geometry=graft(sort_list.ValuesValuesA), Tolerance=0.0001)  # -> simplify(Topology)
topology_setdictionary = TopologySetDictionary(Topology=topology_bygeometry_2, Dictionary=dictionary_bykeysvalues)  # -> flatten(Topology)

cluster = Cluster_2()  # -> start, curves; disabled

# ----
# Define Elements
material_selection_karamba3d = MatSelect(menu=[dropdown(2), dropdown(1)])  # disabled
number_slider = Slider(100, range=20..200)  # disabled
number_slider_2 = Slider(60, range=10..60)  # disabled
cross_section_karamba3d = CroSec(
    FamilyNameOfCrossSection="DefaultCroSec",
    Material=material_selection_karamba3d,
    Height_cm=number_slider,
    UpperFlangeWidth_cm=number_slider,
    LowerFlangeWidth_cm=number_slider,
    mode="Trapezoid")  # disabled
swatch = ColourSwatch(SwatchColor=RGB(0, 42, 255))  # disabled
panel_2 = Panel("Object")  # disabled
# .                                                                        Karamba3D                                                                        .
create_linear_element_karamba3d = LineElem(
    Line=cluster.curves,
    Colour=swatch,
    Identifier=panel_2,
    CrossSection=cross_section_karamba3d,
    LimitDistance_m=0.005,
    BucklingLengthY_m=-1,
    BucklingLengthZ_m=-1,
    BucklingLengthLT_m=-1,
    Bending=True,
    ToPolylineMaxAngle=0.03,
    ToPolylineTolerance=0.01,
    ToPolylineMaxEdgeLength=0.25,
    New=True,
    Remove=True,
    mode="LineToBeam")  # -> Element, Points, Info; disabled

panel_3 = Panel(topology_setdictionary)
cellcomplex_bycells_2 = CellComplexByCells(Cells=topology_setdictionary)

# ----
# Define Load
line_load_kn = Slider(10, range=0.1..10)  # disabled
Z = UnitZ(Factor=line_load_kn)  # disabled
panel_4 = Panel("BlockLoad")  # disabled
panel_5 = Panel("Object")  # disabled
panel_6 = Panel("Gravity")  # disabled
neg = Negative(Value=Z)  # disabled
beam_loads_karamba3d = BeamLoads(BeamIdentifier=panel_5, LoadCase=panel_4, ForceVector=neg, TStart=0, TEnd=1, mode="Block", menu=[buttons(off, on, off)])  # disabled
loads_karamba3d = Loads(Vector=Vector(0, 0, -1), LCase=panel_6, mode="Gravity")  # disabled
load = LoadKaramba3D(flatten([beam_loads_karamba3d, loads_karamba3d]))  # disabled

# ----
# Assign Basic Dictionaries
topology_dictionary = TopologyDictionary(Topology=topology_setdictionary)  # disabled
topology_centroid = TopologyCentroid(Topology=topology_setdictionary)  # -> graft(Centroid); disabled
dictionary_valueatkey = DictionaryValueAtKey(Dictionary=graft(topology_dictionary), Key=panel)  # -> simplify(Value); disabled
number_slider_3 = Slider(100, range=0..100)  # disabled
# .                                                                        Topologic                                                                        .
topology_geometry = TopologyGeometry(Topology=topology_centroid, Tolerance=0.0001)  # -> simplify(Geometry); disabled
text_join = TextJoin(Text=dictionary_valueatkey)  # disabled
swatch_2 = ColourSwatch(SwatchColor=RGB(112, 217, 255))  # disabled
xz_plane = XZPlane(Origin=topology_geometry)  # disabled
text_tag_3d = TextTag3D(Location=xz_plane, Text=text_join, Size=number_slider_3, Colour=swatch_2, Justification=7)  # disabled

# ----
# Define Joint
# Import Models
# Create Dictionaries By Cell
panel_7 = Panel("B-")  # disabled
concatenate = Concatenate(FragmentA=panel_7, FragmentB=series)  # disabled
# .                                                                        Topologic                                                                        .
# Assign Basic Dictionaries
# Import Dictionaries By Cell (Data From External Plug-In)
# Import Dictionaries By Cell (Data From External Plug-In)
# Export Graph
# Common Faces
# .                                                                        Karamba3D                                                                        .
# View Result
# Define Elements
# Analyse Model
# Assemble Model
# Define Support
# Define Load
# Define Joint
beam_joints_karamba3d = BeamJoints(
    BeamIdentifier=concatenate,
    CtKNMAtStartingNode=Vector(0, 0, 0),
    CrKNmRadAtStartingNode=Vector(0, 0, 0),
    CtKNMAtEndNode=Vector(0, 0, 0),
    CrKNmRadAtEndNode=Vector(0, 0, 0),
    menu=[buttons(on, on, on, on, on, on), buttons(on, on, on, on, on, on)])  # disabled

# ----
# Define Support
support_karamba3d = Supp(PosInd=cluster.start, menu=[buttons(on, on, on, on, on, on)])  # disabled
support = SupportKaramba3D(flatten(support_karamba3d))  # disabled

# ----
# Assemble Model
assemble_model_karamba3d = Assemble(
    Elem=create_linear_element_karamba3d.Element,
    Support=support,
    Load=load,
    Joint=beam_joints_karamba3d,
    LimitDistance_m=0.005)  # -> Model, Info, Mass_kg, CentreOfGravity, LoadCaseNames; disabled

graph_bytopology = GraphByTopology(
    Topology=cellcomplex_bycells_2,
    Direct=True,
    ViaSharedTopologies=False,
    ViaSharedApertures=False,
    ToExteriorTopologies=False,
    ToExteriorApertures=False,
    UseFaceInternalVertex=False,
    Tolerance=0.0001)  # disabled
panel_8 = Panel(assemble_model_karamba3d.LoadCaseNames)  # disabled

# ----
# Analyse Model
analyse_karamba3d = Analyse(Model=assemble_model_karamba3d.Model)  # -> AnalysedModel, simplify(MaximumDisplacement_cm), ResultingForce_kN, ChangeOfElasticEnergy_kNm; disabled
panel_9 = Panel("0")  # disabled
panel_10 = Panel(analyse_karamba3d.MaximumDisplacement_cm)  # disabled

graph_vertices = GraphVertices(Graph=graph_bytopology)  # disabled

# ----
# Export Graph
graph_bytopology_2 = GraphByTopology(
    Topology=cellcomplex_bycells_2,
    Direct=True,
    ViaSharedTopologies=invert(False),
    ViaSharedApertures=False,
    ToExteriorTopologies=False,
    ToExteriorApertures=False,
    UseFaceInternalVertex=False,
    Tolerance=0.0001)  # disabled
graph_topology = GraphTopology(Graph=graph_bytopology_2)  # disabled
graph_vertices_2 = GraphVertices(Graph=graph_bytopology_2)  # disabled
joint_topology = TopologyGeometry(Topology=graph_vertices_2, Tolerance=0.0001)  # disabled
joint_topology_2 = TopologyGeometry(Topology=graph_topology, Tolerance=0.0001)  # disabled

# ----
# Common Faces
cellcomplex_nonmanifoldfaces = CellComplexNonManifoldFaces(CellComplex=graft(cellcomplex_bycells_2))  # disabled
joint_topology_3 = TopologyGeometry(Topology=cellcomplex_nonmanifoldfaces, Tolerance=0.0001)  # disabled

flatten_tree = FlattenTree(Tree=panel_8, Path="{0}")  # disabled

# ----
# Import Dictionaries By Cell (Data From External Plug-In)
panel_11 = Panel("LD")  # disabled
dictionary_bykeysvalues_2 = DictionaryByKeysValues(Keys=panel_11, Values=graft(flatten_tree))  # disabled
topology_setdictionary_2 = TopologySetDictionary(Topology=graph_vertices, Dictionary=dictionary_bykeysvalues_2)  # -> simplify(Topology); disabled
topology_dictionary_2 = TopologyDictionary(Topology=topology_setdictionary_2)  # disabled
dictionary_valueatkey_2 = DictionaryValueAtKey(Dictionary=topology_dictionary_2, Key=simplify(graft(panel_11)))  # -> simplify(Value); disabled

# ----
# View Result
panel_12 = Panel("20")  # disabled
cluster_2 = Cluster(C=panel_12)  # disabled
beam_forces_karamba3d = BForces(AnalysedModel=analyse_karamba3d.AnalysedModel, Ts=cluster_2)  # -> Model, NormalForce_kN, ShearForceVz_kN, ShearForceVy_kN, TorsionalMomentMt_kNm, BendingMomentMy_kNm, BendingMomentMz_kNm, LoadCaseIndex; disabled
result_selector_karamba3d = ResultSelect(
    Model=analyse_karamba3d.AnalysedModel,
    menu=[buttons(on, on), dropdown(1), dropdown(0), buttons(off, off, off, off, off, off, off), buttons(off, off, off, off, off, off), buttons(off, off, off, off, off, off, off, off), buttons(off, off, off, off, off, off, off, off)])  # -> Model, LoadCaseSelection; disabled
num = Number(analyse_karamba3d.MaximumDisplacement_cm)  # disabled
abs = Absolute(Value=beam_forces_karamba3d.BendingMomentMy_kNm)  # disabled
model_view_karamba3d = ModelView(Model=result_selector_karamba3d.Model)  # -> Model, DeformedMesh, DeformedAxes, DeformedModel, MaximumDeformation; disabled
sort = SortList(Keys=flatten(abs), ValuesA=flatten(beam_forces_karamba3d.BendingMomentMy_kNm))  # -> Keys, ValuesA; disabled
sort_2 = SortList(Keys=flatten(num), ValuesA=flatten(num))  # -> Keys, ValuesA; disabled
item = ListItem(List=reverse(sort.ValuesA), Index=0, Wrap=True)  # disabled
item_2 = ListItem(List=reverse(sort_2.ValuesA), Index=0, Wrap=True)  # disabled
expression = Expression(x=item, Expression="\"Max. Bending Moment My: \" &Round(x,1)& \" kNm\"")  # disabled
expression_2 = Expression(x=item_2, Expression="\"Max. Displacement: \" &Round(x,1)& \" cm\"")  # disabled
beam_view_karamba3d = BeamView(Model=model_view_karamba3d.Model)  # -> Model, MeshesOfRenderedBeams, DeformedBeamAxes, LegendColours, LegendTags; disabled
panel_13 = Panel("""0,-0.5,-1
0,-0.5,-1.5""")  # disabled
legend = Legend(Colour=beam_view_karamba3d.LegendColours, Tags=beam_view_karamba3d.LegendTags, LegendType=1)  # disabled
# Visualisation of
# all imported Dictionaries
# Visualisation
# Visualisation of Connection
panel_14 = Panel("0.1")  # disabled
xz = XZPlane(Origin=panel_13)  # disabled
tag = TextTag3D(Location=xz, Text=[expression, expression_2], Size=panel_14, Justification=7)  # disabled

panel_15 = Panel(dictionary_valueatkey_2)  # disabled
path_mapper = PathMapper(panel_15, source="{A;B}", target="{A}")  # disabled
panel_16 = Panel(path_mapper)  # disabled
explode_tree = ExplodeTree(Data=panel_16)  # -> graft(Branch0), graft(Branch1); disabled

# ----
# Visualisation of Connection
cellcomplex_faces = CellComplexFaces(CellComplex=cellcomplex_bycells_2)  # disabled
topology_geometry_2 = TopologyGeometry(Topology=cellcomplex_faces, Tolerance=0.0001)  # disabled
faceutility_adjacentcells = FaceUtilityAdjacentCells(Face=cellcomplex_faces, ParentTopology=cellcomplex_bycells_2)  # -> simplify(Cells); disabled
topology_dictionary_3 = TopologyDictionary(Topology=faceutility_adjacentcells)  # disabled
panel_17 = Panel(faceutility_adjacentcells)  # disabled
dictionary_valueatkey_3 = DictionaryValueAtKey(Dictionary=topology_dictionary_3, Key=panel)  # -> simplify(Value); disabled
path_mapper_2 = PathMapper(dictionary_valueatkey_3, source="{A;B}", target="{A}")  # disabled
panel_18 = Panel(path_mapper_2)  # disabled

# ----
# Visualisation
number_slider_4 = Slider(2.536, range=0..100)  # disabled
number_slider_5 = Slider(30, range=0..30)  # disabled
number_slider_6 = Slider(30, range=0..30)  # disabled
number_slider_7 = Slider(30, range=0..30)  # disabled
colour_swatch = ColourSwatch(SwatchColor=RGB(255, 0, 0))  # disabled
colour_swatch_2 = ColourSwatch(SwatchColor=RGB(0, 140, 0))  # disabled
colour_swatch_3 = ColourSwatch(SwatchColor=RGBA(0, 0, 0, 0))  # disabled
colour_swatch_4 = ColourSwatch(SwatchColor=RGB(255, 0, 0))  # disabled
colour_swatch_5 = ColourSwatch(SwatchColor=RGB(0, 146, 255))  # disabled
colour_swatch_6 = ColourSwatch(SwatchColor=RGBA(98, 186, 0, 65))  # disabled
sphere = Sphere(Base=joint_topology, Radius=number_slider_4)  # disabled
deconstruct_brep = DeconstructBrep(Brep=joint_topology_3)  # -> Faces, Edges, Vertices; disabled
deconstruct_brep_2 = DeconstructBrep(Brep=sort_list.ValuesValuesA)  # -> Faces, Edges, Vertices; disabled
custom_preview_lineweights = CustomPreviewLineweights(Geometry=joint_topology_2, Shader=colour_swatch_5, Thickness=graft(number_slider_7), Absolute=False)  # disabled
custom_preview_lineweights_2 = CustomPreviewLineweights(Geometry=deconstruct_brep.Edges, Shader=colour_swatch_2, Thickness=graft(number_slider_5), Absolute=False)  # disabled
custom_preview_lineweights_3 = CustomPreviewLineweights(Geometry=deconstruct_brep_2.Edges, Shader=colour_swatch_4, Thickness=graft(number_slider_6), Absolute=False)  # disabled
custom_preview = CustomPreview(Geometry=sphere, Material=colour_swatch)  # disabled
custom_preview_2 = CustomPreview(Geometry=joint_topology_3, Material=colour_swatch_6)  # disabled
custom_preview_3 = CustomPreview(Geometry=sort_list.ValuesValuesA, Material=colour_swatch_3)  # disabled

number_slider_8 = Slider(0.342, range=0..100)  # disabled

# ----
# Visualisation of
# all imported Dictionaries
topology_geometry_3 = TopologyGeometry(Topology=topology_setdictionary_2, Tolerance=0.0001)  # disabled
panel_19 = Panel("")  # disabled
concatenate_2 = Concatenate(FragmentA=explode_tree.Branch0, FragmentB=panel_19)  # disabled
xz_plane_2 = XZPlane(Origin=topology_geometry_3)  # disabled
concatenate_3 = Concatenate(FragmentA=concatenate_2, FragmentB=explode_tree.Branch1)  # disabled
text_join_2 = TextJoin(Text=concatenate_3)  # disabled
swatch_3 = ColourSwatch(SwatchColor=RGB(0, 0, 0))  # disabled
text_tag_3d_2 = TextTag3D(Location=xz_plane_2, Text=text_join_2, Size=number_slider_8, Colour=swatch_3, Justification=7)  # disabled

# ==== cluster Cluster
C = ClusterInput()
series = Series(Start=0, Step=1, Count=C)
bnd = Bounds(Numbers=series)
remap = RemapNumbers(Value=series, Source=bnd, Target="0 to 1")  # -> Mapped, Clipped
C_2 = ClusterOutput(remap.Clipped)

# ==== cluster Cluster_2
curve = Curve(<curve referenced from the Rhino model>)
curve_2 = Curve(<curve referenced from the Rhino model>)
curve_3 = Curve(<curve referenced from the Rhino model>)
curve_4 = Curve(<curve referenced from the Rhino model>)
curve_5 = Curve(<curve referenced from the Rhino model>)
curve_6 = Curve(<curve referenced from the Rhino model>)
curve_7 = Curve(<curve referenced from the Rhino model>)
end_points = EndPoints(Curve=curve)  # -> Start, End
end_points_2 = EndPoints(Curve=curve_2)  # -> Start, End
end_points_3 = EndPoints(Curve=curve_3)  # -> Start, End
end_points_4 = EndPoints(Curve=curve_4)  # -> Start, End
end_points_5 = EndPoints(Curve=curve_5)  # -> Start, End
end_points_6 = EndPoints(Curve=curve_6)  # -> Start, End
end_points_7 = EndPoints(Curve=curve_7)  # -> Start, End
start = ClusterOutput(end_points.Start)
join_curves = JoinCurves(Curves=[curve, curve_2, curve_3, curve_4, curve_5, curve_6, curve_7], Preserve=False)  # -> flatten(Curves)
curves = ClusterOutput(join_curves)
